# Grasshopper definition brickwall.gh (Grasshopper 1.0.8)

x_end = GetInteger(Slider(73, range=0..100), AtLeast=1, AtMost=1, Maximum=2147483647, Minimum=-2147483648, TreeAccess=False)
y_end = GetInteger(Slider(96, range=0..100), AtLeast=1, AtMost=1, Maximum=2147483647, Minimum=-2147483648, TreeAccess=False)
x_start = GetInteger(Slider(14, range=0..100), AtLeast=1, AtMost=1, Maximum=2147483647, Minimum=-2147483648, TreeAccess=False)
y_start = GetInteger(Slider(27, range=0..100), AtLeast=1, AtMost=1, Maximum=2147483647, Minimum=-2147483648, TreeAccess=False)
construct_point = ConstructPoint(XCoordinate=Slider(25, range=0..100), YCoordinate=Slider(34, range=0..100), ZCoordinate=0)
construct_point_2 = ConstructPoint(XCoordinate=x_end, YCoordinate=y_end, ZCoordinate=0)
construct_point_3 = ConstructPoint(XCoordinate=Slider(50, range=0..100), YCoordinate=Slider(72, range=0..100), ZCoordinate=0)
construct_point_4 = ConstructPoint(XCoordinate=x_start, YCoordinate=y_start, ZCoordinate=0)
merge = Merge(Data1=construct_point_4, Data2=construct_point, Data3=construct_point_3, Data4=construct_point_2)
wallheight = GetInteger(Slider(20, range=0..100), AtLeast=1, AtMost=1, Maximum=2147483647, Minimum=-2147483648, TreeAccess=False)
interpolate = Interpolate(Vertices=merge, Degree=3, Periodic=False, KnotStyle=1)  # -> Curve, Length, Domain
unit_z = UnitZ(Factor=wallheight)
move = Move(Geometry=interpolate.Curve, Motion=unit_z)  # -> Geometry, Transform
subdivision = GetInteger(Slider(7, range=0..10), AtLeast=1, AtMost=1, Maximum=2147483647, Minimum=-2147483648, TreeAccess=False)
loft = Loft(
    Curves=[interpolate.Curve, move.Geometry],
    Options={Adjust=False, Closed=False, LoftEnds=0, LoftSimp=0, LoftType=0, Rebuild=10, Refit=0.01})
point_on_curve = PointOnCurve([move.Geometry, interpolate.Curve], parameter=0.5)
polyline = PolyLine(Vertices=point_on_curve, Closed=False)
division = Division(A=wallheight, B=subdivision)
divide_curve = DivideCurve(Curve=polyline, Count=subdivision, Kinks=False)  # -> Points, Tangents, Parameters
brep_plane = BrepPlane(Brep=loft, Plane=divide_curve.Points)  # -> flatten(Curves), Points
dispatch = Dispatch(List=brep_plane.Curves, DispatchPattern=[True, False])  # -> ListA, ListB
length = Length(Curve=move.Geometry)
number_slider = Slider(21, range=0..100)
subtraction = Subtraction(A=number_slider, B=Slider(10, range=0..100))
bricksize = GetInteger(Slider(2.3, range=0..20), AtLeast=1, AtMost=1, Maximum=2147483647, Minimum=-2147483648, TreeAccess=False)
division_2 = Division(A=length, B=subtraction)
horizontal_frames = HorizontalFrames(Curve=dispatch.ListA, Count=number_slider)  # -> Frames, Parameters
horizontal_frames_2 = HorizontalFrames(Curve=dispatch.ListB, Count=number_slider)  # -> Frames, Parameters
domain_box = DomainBox(Base=PlaneXY(0, 0, 0), X=division_2, Y=bricksize, Z=division)
deconstruct_brep = DeconstructBrep(Brep=domain_box)  # -> Faces, Edges, Vertices
dispatch_2 = Dispatch(List=horizontal_frames.Frames, DispatchPattern=[True, False])  # -> ListA, ListB
dispatch_3 = Dispatch(List=horizontal_frames_2.Frames, DispatchPattern=[True, False])  # -> ListA, ListB
list_item = ListItem(List=deconstruct_brep.Faces, Index=Slider(4, range=0..10), Wrap=True)
area = Area(Geometry=list_item)  # -> Area, Centroid
plane = Plane([dispatch_2.ListA, dispatch_3.ListB])
xy_plane = XYPlane(Origin=area.Centroid)
orient = Orient(Geometry=domain_box, Source=xy_plane, Target=plane)  # -> flatten(Geometry), Transform
context_bake = ContextBake(Geometry=orient.Geometry)
