# Grasshopper definition donut.gh (Grasshopper 1.0.8)

pt = ConstructPoint(XCoordinate=0, YCoordinate=0, ZCoordinate=0)
point = GetGeometry(pt, AnnotationTypeFilter=3966, AtLeast=1, AtMost=1, DeleteInput=False, Filter=1074081855, TreeAccess=False)
radius = GetInteger(Slider(5, range=0..10), AtLeast=1, AtMost=1, Maximum=2147483647, Minimum=-2147483648, TreeAccess=False)
thickness = GetInteger(Slider(0.66, range=0..1), AtLeast=1, AtMost=1, Maximum=2147483647, Minimum=-2147483648, TreeAccess=False)
cir = Circle(Plane=point, Radius=radius)
pipe = Pipe(Curve=cir, Radius=thickness, Caps=0)
context_bake = ContextBake(Content=pipe)
