# Grasshopper definition waveypanel.gh (Grasshopper 1.0.8)

# ----
# X-axis Length
# Y-axis section Locations
x_dimensions = Slider(200, range=0..200)
wave_length_param_1 = Slider(78, range=0..100)
wave_length_param_2 = Slider(-64, range=-100..10)
y_dimensions = Slider(-100, range=-100..100)

x_dimensions_2 = GetInteger(x_dimensions, AtLeast=1, AtMost=1, Maximum=2147483647, Minimum=-2147483648, TreeAccess=False)
wave_length_param_1_2 = GetInteger(wave_length_param_1, AtLeast=1, AtMost=1, Maximum=2147483647, Minimum=-2147483648, TreeAccess=False)
wave_length_param_2_2 = GetInteger(wave_length_param_2, AtLeast=1, AtMost=1, Maximum=2147483647, Minimum=-2147483648, TreeAccess=False)
wave_length_param_3 = GetInteger(Slider(100, range=0..100), AtLeast=1, AtMost=1, Maximum=2147483647, Minimum=-2147483648, TreeAccess=False)
y_dimensions_2 = GetInteger(y_dimensions, AtLeast=1, AtMost=1, Maximum=2147483647, Minimum=-2147483648, TreeAccess=False)

construct_domain = ConstructDomain(DomainStart="0", DomainEnd=x_dimensions_2)
vector_xyz = VectorXYZ(XComponent=0, YComponent=wave_length_param_3, ZComponent=0)  # -> Vector, Length
vector_xyz_2 = VectorXYZ(XComponent=0, YComponent=wave_length_param_1_2, ZComponent=0)  # -> Vector, Length
vector_xyz_3 = VectorXYZ(XComponent=0, YComponent=wave_length_param_2_2, ZComponent=0)  # -> Vector, Length
vector_xyz_4 = VectorXYZ(XComponent=0, YComponent=y_dimensions_2, ZComponent=0)  # -> Vector, Length

# ----
# Wave amount
resolution = Slider(46, range=0..200)
amount = Slider(2.4, range=0..10)
range = Range(Domain=construct_domain, Steps=resolution)
multiplication = Multiplication(A=range, B=amount)
sine = Sine(Value=multiplication)

# ----
# Curve end fading (X-axis direction)
panel = Panel("1")
range_2 = Range(Domain=panel, Steps=resolution)
panel_2 = Panel(range_2)
graph_mapper = GraphMapper(
    simplify(panel_2),
    x0=0,
    x1=1,
    y0=0,
    y1=2,
    container_name="Gaussian",
    factor=0.1025303602,
    mean=0.5153896213,
    sdev=0.1692464352)
multiplication_2 = Multiplication(A=graph_mapper, B=sine)

# ----
# original straight curve
construct_point = ConstructPoint(XCoordinate=range, YCoordinate=0, ZCoordinate=0)

# ----
# Cross section 1 (Straight line)
move = Move(Geometry=construct_point, Motion=vector_xyz.Vector)  # -> Geometry, Transform
nurbs_curve = NurbsCurve(Vertices=move.Geometry, Degree=3, Periodic=False)  # -> Curve, Length, Domain

# ----
# Cross section 6 (Straight line)
move_2 = Move(Geometry=construct_point, Motion=vector_xyz_4.Vector)  # -> Geometry, Transform
nurbs_curve_2 = NurbsCurve(Vertices=move_2.Geometry, Degree=3, Periodic=False)  # -> Curve, Length, Domain

# ----
# Cross section 2 (straight line)
move_3 = Move(Geometry=construct_point, Motion=vector_xyz_2.Vector)  # -> Geometry, Transform
nurbs_curve_3 = NurbsCurve(Vertices=move_3.Geometry, Degree=3, Periodic=False)  # -> Curve, Length, Domain

# ----
# Cross section 5 (Straight line)
move_4 = Move(Geometry=construct_point, Motion=vector_xyz_3.Vector)  # -> Geometry, Transform
nurbs_curve_4 = NurbsCurve(Vertices=move_4.Geometry, Degree=3, Periodic=False)  # -> Curve, Length, Domain

# ----
# height of wave
number_slider = Slider(70, range=0..100)
multiplication_3 = Multiplication(A=multiplication_2, B=number_slider)

# ----
# Wave finetuning
graph_mapper_2 = GraphMapper(
    multiplication_3,
    x0=0,
    x1=1,
    y0=0,
    y1=1,
    A=0.8653942935,
    B=-0.1854910786,
    container_name="Linear",
    Graph_x0=0.3880368471,
    Graph_x1=0.6859039664,
    Graph_y0=0.1503137946,
    Graph_y1=0.4080862999)

# ----
# Cross section 4 (wave curve)
construct_point_2 = ConstructPoint(XCoordinate=range, YCoordinate=0, ZCoordinate=graph_mapper_2)
nurbs_curve_5 = NurbsCurve(Vertices=construct_point_2, Degree=3, Periodic=False)  # -> Curve, Length, Domain

# ----
# Cross section 3 (Wave Curve )
number_slider_2 = Slider(36, range=0..100)
vector_xyz_5 = VectorXYZ(XComponent=0, YComponent=number_slider_2, ZComponent=0)  # -> Vector, Length
move_5 = Move(Geometry=nurbs_curve_5.Curve, Motion=vector_xyz_5.Vector)  # -> Geometry, Transform

# ----
# Surface Creation
number_slider_3 = Slider(137, range=0..200)
rebuild_curve = RebuildCurve(
    Curve=[nurbs_curve.Curve, nurbs_curve_3.Curve, move_5.Geometry, nurbs_curve_5.Curve, nurbs_curve_4.Curve, nurbs_curve_2.Curve],
    Count=number_slider_3,
    Tangents=False)
loft = Loft(Curves=rebuild_curve, Options={Adjust=False, Closed=False, LoftEnds=0, LoftSimp=0, LoftType=1, Rebuild=10, Refit=0.01})
custom_preview = CustomPreview(Geometry=loft, Material=ColourSwatch(SwatchColor=RGB(255, 255, 255)))

context_bake = ContextBake(Geometry=loft)
